# Requirement set CochlearImplantRequirements (R2026b)

## 1 [SP] Signal Processing (Container)

### 1.1 [SP-01] DC-blocking input filter
The input signal shall be high-pass filtered to remove DC and sub-audio content before frequency analysis (3rd-order Butterworth, normalized cutoff 0.015).

### 1.2 [SP-02] Eight frequency channels
The speech processor shall decompose the input signal into exactly 8 frequency subband channels.

#### 1.2.1 [INFO-01] Background: eight channels (Informational)
Research shows about eight frequency channels suffice for good speech intelligibility in a cochlear implant; beyond that, quality gains rarely justify the added complexity.

### 1.3 [SP-03] Envelope extraction (non-negative)
Each subband channel shall be full-wave rectified so that the signal driving each electrode is non-negative (an amplitude envelope).

### 1.4 [SP-04] Optional soft-threshold denoising
The processor shall provide a selectable denoising stage that applies per-band soft thresholding to the subband signals.

## 2 [ST] Electrical Stimulation (Container)

### 2.1 [ST-01] Charge-balanced biphasic pulses
Each stimulation pulse shall be biphasic and charge-balanced, i.e. the net charge (sum of the pulse samples) over one pulse period shall be zero.

### 2.2 [ST-02] Interleaved electrode stimulation
No two electrode channels shall deliver a stimulation pulse at the same sample instant (continuous interleaved sampling).

### 2.3 [ST-03] Amplitude encodes loudness
The amplitude of each electrode pulse shall be proportional to the envelope (loudness) of its corresponding frequency subband.